# Grasshopper definition main.ghx (Grasshopper 1.0.7)

number_slider = Slider(5, range=0..10)
construct_domain = ConstructDomain(DomainStart=expr("-x", number_slider), DomainEnd=number_slider)
rectangle = Rectangle(Plane=PlaneXY(0, 0, 0), XSize=construct_domain, YSize=construct_domain, Radius=0)  # -> Rectangle, Length
rectangular_array = RectangularArray(Geometry=rectangle.Rectangle, Cell=rectangle.Rectangle, XCount=Slider(10, range=0..10), YCount=Slider(10, range=0..10))  # -> Geometry, Transform
